# Grasshopper definition san.gh (Grasshopper 1.0.4)
# plug-ins: Firefly.Core

ports_available = COMPortsAvailable()
panel = Panel(ports_available)
open_port = OpenClosePort(OpenClosePort=Toggle(True), PortNumber="86", BaudRate=115200)
panel_2 = Panel(open_port)
